# Grasshopper definition noisedGeode-3d.gh (Grasshopper 1.0.7)
# plug-ins: Chromodoris, Weaverbird, Noise 4D

curve = Curve([<curve referenced from the Rhino model> x5])
loft = Loft(Curves=curve, Options={Adjust=False, Closed=False, LoftEnds=0, LoftSimp=0, LoftType=0, Rebuild=10, Refit=0.01})
divide_surface = DivideSurface(Surface=loft, UCount=Slider(50, range=0..100), VCount=Slider(50, range=0..100))  # -> Points, Normals, Parameters
flip_matrix = FlipMatrix(Data=simplify(divide_surface.Points))
polyline = PolyLine(Vertices=divide_surface.Points, Closed=False)
polyline_2 = PolyLine(Vertices=flip_matrix, Closed=False)
merge = Merge(Data1=polyline, Data2=polyline_2)
explode = Explode(Curve=merge, Recursive=True)  # -> flatten(Segments), Vertices
weaverbird_s_mesh_from_lines_weave_back = WeaverbirdsMeshFromLinesWeaveBack(Lines=explode.Segments, MaximumValence=4)

brep = Brep(<brep referenced from the Rhino model>)
contour = Contour(Shape=brep, Point=Point(0, 0, 0), Direction=Vector(0, 0, 1), Distance=Slider(6, range=0..10))
curve_to_polyline = CurveToPolyline(Curve=flatten(contour), ToleranceDistance=Slider(0.05, range=0..0.1), ToleranceAngle=0, MinEdge=Slider(3, range=0..10))  # -> Polyline, Segments
mesh_pipe = MeshPipe(
    Polylines=graft(curve_to_polyline.Polyline),
    NumberOfSides=Slider(8, range=0..10),
    Radius=Slider(3.6, range=0..10),
    Cap=False)
group = Group(Objects=flatten(mesh_pipe))

cap_holes = CapHoles(Brep=brep)
settings_quality = SettingsQuality()
mesh_brep = MeshBrep(Brep=cap_holes, Settings=settings_quality)
deconstruct_mesh = DeconstructMesh(Mesh=mesh_brep)  # -> Vertices, Faces, Colours, Normals
construct_mesh = ConstructMesh(Vertices=deconstruct_mesh.Vertices, Faces=deconstruct_mesh.Faces, Colours=deconstruct_mesh.Normals)

# ----
# nozzle : 3mm
# threshold : 1 mm
# 
# 2 times the nozzle + threshold
# 
# 2 x 3 + 1 = 7mm
# 
# 7 / 2 = 3.5
number_slider = Slider(3.5, range=0..10)
negative = Negative(Value=number_slider)

# ----
# here bake and fillet edges
curve_2 = Curve([<curve referenced from the Rhino model> x4])
curve_3 = Curve([<curve referenced from the Rhino model> x4])
loft_2 = Loft(Curves=curve_3, Options={Adjust=False, Closed=False, LoftEnds=0, LoftSimp=0, LoftType=0, Rebuild=10, Refit=0.01})
loft_3 = Loft(Curves=curve_2, Options={Adjust=False, Closed=False, LoftEnds=0, LoftSimp=0, LoftType=0, Rebuild=10, Refit=0.01})
number_slider_2 = Slider(10, range=0..10)
contour_2 = Contour(Shape=loft_3, Point=Point(0, 0, 0), Direction=Vector(0, 0, 1), Distance=number_slider_2)
contour_3 = Contour(Shape=loft_2, Point=Point(0, 0, 0), Direction=Vector(0, 0, 1), Distance=number_slider_2)
list_item = ListItem(List=flatten(contour_3), Index=0, Wrap=True)
list_item_2 = ListItem(List=flatten(contour_2), Index=0, Wrap=True)
flip_curve = FlipCurve(Curve=contour_3, Guide=list_item)  # -> Curve, Flag
flip_curve_2 = FlipCurve(Curve=contour_2, Guide=list_item_2)  # -> Curve, Flag
curve_proximity = CurveProximity(CurveA=flip_curve_2.Curve, CurveB=flip_curve.Curve)  # -> PointA, PointB, Distance
curve_closest_point = CurveClosestPoint(Point=curve_proximity.PointB, Curve=flip_curve.Curve)  # -> Point, Parameter, Distance
curve_closest_point_2 = CurveClosestPoint(Point=curve_proximity.PointA, Curve=flip_curve_2.Curve)  # -> Point, Parameter, Distance
seam = Seam(Curve=flip_curve.Curve, Seam=curve_closest_point.Parameter)
seam_2 = Seam(Curve=flip_curve_2.Curve, Seam=curve_closest_point_2.Parameter)
number_slider_3 = Slider(0.05, range=0..0.1)
extend_curve = ExtendCurve(Curve=seam_2, Type=0, Start=negative, End=negative)
extend_curve_2 = ExtendCurve(Curve=seam, Type=0, Start=negative, End=negative)
end_points = EndPoints(Curve=extend_curve_2)  # -> Start, End
curve_to_polyline_2 = CurveToPolyline(Curve=extend_curve_2, ToleranceDistance=number_slider_3, ToleranceAngle=0)  # -> Polyline, Segments
curve_to_polyline_3 = CurveToPolyline(Curve=extend_curve, ToleranceDistance=number_slider_3, ToleranceAngle=0)  # -> Polyline, Segments
end_points_2 = EndPoints(Curve=extend_curve)  # -> Start, End
loft_options = LoftOptions(Closed=False, Adjust=False, Rebuild=Slider(800, range=0..1000), Refit=0, Type=0)
loft_options_2 = LoftOptions(Closed=False, Adjust=False, Rebuild=Slider(100, range=0..1000), Refit=0, Type=0)
line = Line(StartPoint=end_points_2.Start, EndPoint=end_points.End)
line_2 = Line(StartPoint=end_points_2.End, EndPoint=end_points.Start)
loft_4 = Loft(Curves=flatten(curve_to_polyline_3.Polyline), Options=loft_options)
loft_5 = Loft(Curves=flatten(line), Options=loft_options_2)
loft_6 = Loft(Curves=flatten(curve_to_polyline_2.Polyline), Options=loft_options)
loft_7 = Loft(Curves=flatten(line_2), Options=loft_options_2)
merge_2 = Merge(Data1=loft_5, Data2=loft_6, Data3=loft_4, Data4=loft_7)  # -> flatten(Result)
brep_join = BrepJoin(Breps=merge_2)  # -> Breps, Closed

# ---- group: automated flip check
area = Area(Geometry=contour_3)  # -> Area, Centroid
curve_side = CurveSide(Curve=contour_3, Point=area.Centroid)  # -> Side, Left, Right
panel = Panel(curve_side.Right)

# ---- group: visual flip check
divide_curve = DivideCurve(Curve=flip_curve.Curve, Count=10, Kinks=False)  # -> Points, Tangents, Parameters
point_order = PointOrder(Points=divide_curve.Points)

# ----
weaverbird_s_catmull_clark_subdivision = WeaverbirdsCatmullClarkSubdivision(MeshCurves=weaverbird_s_mesh_from_lines_weave_back, Level=Slider(1, range=0..10), SmoothNakedEdges=1)

# ---- group: close the bre & convert to mesh
brep_2 = Brep(<brep referenced from the Rhino model>)
cap_holes_2 = CapHoles(Brep=brep_2)
settings_quality_2 = SettingsQuality()
mesh_brep_2 = MeshBrep(Brep=cap_holes_2, Settings=settings_quality_2)
deconstruct_mesh_2 = DeconstructMesh(Mesh=mesh_brep_2)  # -> Vertices, Faces, Colours, Normals
construct_mesh_2 = ConstructMesh(Vertices=deconstruct_mesh_2.Vertices, Faces=deconstruct_mesh_2.Faces, Colours=deconstruct_mesh_2.Normals)

# ----
weaverbird_s_mesh_thicken = WeaverbirdsMeshThicken(Distance=Slider(0.9, range=0..1), OffsetType=0)

curve_4 = Curve([<curve referenced from the Rhino model> x4])
loft_8 = Loft(Curves=curve_4, Options={Adjust=False, Closed=False, LoftEnds=0, LoftSimp=0, LoftType=0, Rebuild=10, Refit=0.01})
divide_surface_2 = DivideSurface(Surface=loft_8, UCount=Slider(50, range=0..100), VCount=Slider(50, range=0..100))  # -> Points, Normals, Parameters
flip_matrix_2 = FlipMatrix(Data=simplify(divide_surface_2.Points))
polyline_3 = PolyLine(Vertices=divide_surface_2.Points, Closed=False)
polyline_4 = PolyLine(Vertices=flip_matrix_2, Closed=False)
merge_3 = Merge(Data1=polyline_3, Data2=polyline_4)
explode_2 = Explode(Curve=merge_3, Recursive=True)  # -> flatten(Segments), Vertices
weaverbird_s_mesh_from_lines_weave_back_2 = WeaverbirdsMeshFromLinesWeaveBack(Lines=explode_2.Segments, MaximumValence=4)
mesh_brep_3 = MeshBrep(
    Brep=loft_8,
    Settings={GridMaxCount=0, GridMinCount=16, JaggedSeams=False, MaxEdgeLength=0, MinEdgeLength=0.0001, MinTolerance=0, Refine=True, RefineAngle=0, RelativeTolerance=0.65, SimplePlanes=True, Tolerance=0})
weaverbird_s_catmull_clark_subdivision_2 = WeaverbirdsCatmullClarkSubdivision(MeshCurves=weaverbird_s_mesh_from_lines_weave_back_2, Level=Slider(1, range=0..10), SmoothNakedEdges=1)
deconstruct_mesh_3 = DeconstructMesh(Mesh=weaverbird_s_catmull_clark_subdivision_2)  # -> Vertices, Faces, Colours, Normals
simplexnoise = SimplexNoise(Values=deconstruct_mesh_3.Vertices, Time=Slider(2.5613, range=0.0001..3), Scale=Slider(0.0095, range=0.0001..0.1))
perlinnoise = PerlinNoise(Values=deconstruct_mesh_3.Vertices, Time=Slider(2.5613, range=0.0001..3), Scale=Slider(0.0286, range=0.0001..0.1))
gradient = Gradient(LowerLimit="-1", UpperLimit="1", Parameter=perlinnoise, stops=[0: RGB(255, 255, 255), 1: RGB(0, 0, 0)])

multiplication = Multiplication(A=deconstruct_mesh_3.Normals, B=simplexnoise, C=Slider(10, range=0..10))
multiplication_2 = Multiplication(A=deconstruct_mesh_3.Normals, B=perlinnoise, C=Slider(10, range=0..10))
addition = Addition(A=multiplication_2, B=multiplication)

move = Move(Geometry=deconstruct_mesh_3.Vertices, Motion=addition)  # -> Geometry, Transform
construct_mesh_3 = ConstructMesh(Vertices=move.Geometry, Faces=deconstruct_mesh_3.Faces, Colours=gradient)
deconstruct_mesh_4 = DeconstructMesh(Mesh=construct_mesh_3)  # -> Vertices, Faces, Colours, Normals
construct_mesh_4 = ConstructMesh(Vertices=deconstruct_mesh_4.Vertices, Faces=deconstruct_mesh_4.Faces, Colours=deconstruct_mesh_4.Normals)
weaverbird_s_catmull_clark_subdivision_3 = WeaverbirdsCatmullClarkSubdivision(MeshCurves=construct_mesh_4, Level=1, SmoothNakedEdges=1)

deconstruct_mesh_5 = DeconstructMesh(Mesh=weaverbird_s_catmull_clark_subdivision)  # -> Vertices, Faces, Colours, Normals

# ----
# 0 to X (threshold value)  --> intensity will go from 0 to 1
# GH STRATEGY is REMAP
# 
# after X (threshold value) -->
# intensity will remain 1
# GH STRATEGY is REPEAT DATA
weaverbird_s_naked_boundary = WeaverbirdsNakedBoundary(MeshClosedPolylines=weaverbird_s_catmull_clark_subdivision)
curve_5 = Curve(<curve referenced from the Rhino model>)
list_item_3 = ListItem(List=weaverbird_s_naked_boundary, Index=0, Wrap=True)  # -> Item, Item1
merge_4 = Merge(Data1=weaverbird_s_naked_boundary, Data2=curve_5)  # -> flatten(Result)
pull_point = PullPoint(Point=deconstruct_mesh_5.Vertices, Geometry=merge_4, ClosestOnly=True)  # -> ClosestPoint, Distance
smaller_than = SmallerThan(FirstNumber=pull_point.Distance, SecondNumber=Slider(200, range=0..200))  # -> SmallerThan, OrEqualTo
dispatch = Dispatch(List=pull_point.Distance, DispatchPattern=smaller_than.SmallerThan)  # -> ListA, ListB
dispatch_for_vertices = Dispatch(List=deconstruct_mesh_5.Vertices, DispatchPattern=smaller_than.SmallerThan)  # -> ListA, ListB
bounds = Bounds(Numbers=dispatch.ListA)
list_length = ListLength(List=dispatch.ListB)
remap_numbers = RemapNumbers(Value=dispatch.ListA, Source=bounds, Target="0 to 1")  # -> Mapped, Clipped
repeat_data = RepeatData(Data="1", Length=list_length)
graph_mapper = GraphMapper(
    remap_numbers.Mapped,
    x0=0,
    x1=1,
    y0=0,
    y1=1,
    container_name="Bezier",
    cpx=[0, 0.7819240689, 0.4992056489, 1],
    cpy=[0, 0.2691371441, 0.5988521576, 1])
gate_not = GateNot(A=smaller_than.SmallerThan)
weave = Weave(Pattern=gate_not, Stream0=graph_mapper, Stream1=repeat_data, NullGaps=False)

simplexnoise_2 = SimplexNoise(Values=deconstruct_mesh_5.Vertices, Time=Slider(2.5613, range=0.0001..3), Scale=Slider(0.1, range=0.0001..0.1))
perlinnoise_2 = PerlinNoise(Values=deconstruct_mesh_5.Vertices, Time=Slider(3, range=0.0001..3), Scale=Slider(0.0001, range=0.0001..0.1))
multiplication_3 = Multiplication(A=deconstruct_mesh_5.Normals, B=simplexnoise_2, C=Slider(4.31, range=0..10))
multiplication_4 = Multiplication(A=deconstruct_mesh_5.Normals, B=perlinnoise_2, C=Slider(10, range=0..10))
addition_2 = Addition(A=multiplication_4, B=multiplication_3)

point = Point(dispatch_for_vertices.ListA)

multiplication_5 = Multiplication(A=addition_2, ScaledIntensity=weave)

move_2 = Move(Geometry=deconstruct_mesh_5.Vertices, Motion=multiplication_5)  # -> Geometry, Transform
gradient_2 = Gradient(LowerLimit="-1", UpperLimit="1", Parameter=perlinnoise_2, stops=[0: RGB(255, 255, 255), 1: RGB(0, 0, 0)])
construct_mesh_5 = ConstructMesh(Vertices=move_2.Geometry, Faces=deconstruct_mesh_5.Faces, Colours=gradient_2)
deconstruct_mesh_6 = DeconstructMesh(Mesh=construct_mesh_5)  # -> Vertices, Faces, Colours, Normals
construct_mesh_6 = ConstructMesh(Vertices=deconstruct_mesh_6.Vertices, Faces=deconstruct_mesh_6.Faces, Colours=deconstruct_mesh_6.Normals)
weaverbird_s_catmull_clark_subdivision_4 = WeaverbirdsCatmullClarkSubdivision(MeshCurves=construct_mesh_6, Level=1, SmoothNakedEdges=1)
